# Grasshopper definition Color_Shading_Mesh.gh (Grasshopper 1.0.7)

# ----
# Geometrical Design
panel = Panel("406,-290,0")
radius = Slider(50, range=0..100)
height = Slider(200, range=0..200)
pt = Point(panel)
cir = Circle(Plane=pt, Radius=radius)
Z = UnitZ(Factor=height)
extr = Extrude(Base=cir, Direction=Z)

geometry = Geometry(extr)

# ---- group: Meshing
# Pattern Design
brep = Brep(geometry)
custom_mesh_settings = SettingsCustom(
    StitchSeams=True,
    SimplePlanes=False,
    Refine=True,
    MinCount=16,
    MaxCount=400,
    AspectRatio=20,
    MaxDistance=0,
    MaxAngle=20,
    MinEdge=0,
    MaxEdge=Slider(10, range=0..10))
mesh = MeshBrep(Brep=brep, Settings=custom_mesh_settings)

# ----
mesh_2 = Mesh(mesh)
demesh = DeconstructMesh(Mesh=mesh_2)  # -> Vertices, Faces, Colours, Normals
pdecon = Deconstruct(Point=demesh.Vertices)  # -> XComponent, YComponent, ZComponent

# ---- group: Color Gradient native Grashoper
num = Number(pdecon.ZComponent)
bnd = Bounds(Numbers=num)
dedomain = DeconstructDomain(Domain=bnd)  # -> Start, End
gradient = Gradient(LowerLimit=dedomain.Start, UpperLimit=dedomain.End, Parameter=num, stops=[0.252: RGB(0, 0, 0), 1: RGB(255, 255, 255)])
col = Colour(gradient)

# ---- group: Color gradient via Graph Mapper
num_2 = Number(pdecon.ZComponent)
bnd_2 = Bounds(Numbers=num_2)
remap = RemapNumbers(Value=num_2, Source=bnd_2, Target=Domain(0, 1))  # -> Mapped, Clipped
graph = GraphMapper(
    remap.Clipped,
    x0=0,
    x1=1,
    y0=0,
    y1=1,
    container_name="Bezier",
    cpx=[0, 0.221540451, 0.7357378006, 1],
    cpy=[0, 0.5738463402, 0.3987787366, 1])
num_3 = Number(graph)
frgb = ColourRGBF(Alpha=1, Red=num_3, Green=num_3, Blue=num_3)
col_2 = Colour(frgb)

# ----
list = ValueList({"0. Gradient Gh": 0, "1. GraphMapper": 1}, selected="1. GraphMapper")
filter = StreamFilter(Gate=list, Stream0=col, Stream1=col_2)
conmesh = ConstructMesh(Vertices=demesh.Vertices, Faces=demesh.Faces, Colours=filter)
final_geometry = Mesh(conmesh)
